# Grasshopper definition doorlatch.gh (Grasshopper 0.9.76)
# plug-ins: Karamba, Python Interpreter

# ---- group: File Path With FORWARD SLASHES and NO SPACES
panel = Panel("D:/HCI/fea/doorlatch1.stl")

# ----
python = PythonScript(FILE_PATH=panel)  # -> out, MESH
# ---------- python: Python ----------
import Rhino

mesh = Rhino.Geometry.Mesh() # Initialize "mesh" variable as a blank mesh object to hold each face.
MESH = Rhino.Geometry.Mesh() # Initialize "MESH" variable as a blank mesh object to accumulate faces.

with open(FILE_PATH) as f:

  for line in f:

    if "vertex" in line:
      q = line.replace("      vertex ", "")
      q = q.replace("\n", "")
      q = [float(x) for x in q.split()]
      mesh.Vertices.Add(q[0],q[1],q[2]) # Fill mesh with three vertex lines in a row.

    if "endloop" in line: # File itself tells us we are done with three vertices for one face.
      mesh.Faces.AddFace(0,1,2) # Create a single face mesh.
      MESH.Append(mesh) # Magically build a real multi-face mesh while removing redundant vertices.
      mesh = Rhino.Geometry.Mesh() # Reinitialize empty mesh object for each mesh face.

  MESH.Normals.ComputeNormals() # Gives nice mesh and preview but makes the script take longer.
# ---------- end python ----------
vec = VectorXYZ(XComponent="-400", YComponent="-400", ZComponent=0)  # -> Vector, Length
vec_2 = VectorXYZ(XComponent="400", YComponent="400", ZComponent=0)  # -> Vector, Length
mesh = Mesh(python.MESH)
meshtoshell = MeshToShellKaramba(Mesh=mesh, LDist=0.005)  # -> Point, Element, Info
demesh = DeconstructMesh(Mesh=mesh)  # -> Vertices, Faces, Colours, Normals
cp = ClosestPoint(Point=[<geometry referenced from the Rhino model> x8], Cloud=demesh.Vertices)  # -> ClosestPoint, CPIndex, Distance
cp_2 = ClosestPoint(Point=[<geometry referenced from the Rhino model> x4], Cloud=demesh.Vertices)  # -> ClosestPoint, CPIndex, Distance
cp_3 = ClosestPoint(Point=[<geometry referenced from the Rhino model> x4], Cloud=demesh.Vertices)  # -> ClosestPoint, CPIndex, Distance
supp = SupportKaramba(PosInd=cp.ClosestPoint, menu=[buttons(on, on, on, off, on, off)])
loads = LoadsKaramba(ForceVector=vec.Vector, Local=True, PosInd=cp_3.ClosestPoint, LCase=0, mode="Point")
loads_2 = LoadsKaramba(ForceVector=vec_2.Vector, Local=True, PosInd=cp_2.ClosestPoint, LCase=0, mode="Point")
assemble = AssembleModelKaramba(Elem=meshtoshell.Element, Support=supp, Load=[loads, loads_2], LimitDistance_m=0.005)  # -> Model, Info, Mass_kg, CenterOfGravity
analyzethi = AnalyzeThIKaramba()  # -> CalculatedModel, MaximumDisplacement_m, ResultingForceOfGravity_kN, ElasticEnergy_kNm
modelview = ModelViewKaramba(Model=analyzethi.CalculatedModel, LoadCaseFactorsForLinearSuperposition=1, IndexIncrementOfVisibleLoadcase=0)  # -> Model, DeformedMesh, DeformedAxes, DeformedModel
